# Grasshopper definition Assignment2.gh (Grasshopper 0.9.80)

radius_of_polygon = Slider(1.5, range=1..12)
thickness_of_cardboard = Slider(0.16, range=0..1)
slot_depth = Slider(1, range=0..1)
length_of_slot = Slider(0.667, range=0..1)
number_of_sides_of_polygon = ControlKnob(Decimals=0, Limit=True, Maximum=16, Minimum=3, Range=10, Value=6)
multiplication = Multiplication(A=length_of_slot, B=slot_depth)
subtraction = Subtraction(A=radius_of_polygon, B=multiplication)
rectangle = Rectangle(Plane=PlaneXY(0, 0, 0), XSize=thickness_of_cardboard, YSize=length_of_slot, Radius=0)  # -> Rectangle, Length
_2 = Integer(2)
_2_2 = Integer(-2)
polygon = Polygon(Plane=PlaneXY(0, 0, 0), Radius=radius_of_polygon, Segments=number_of_sides_of_polygon, FilletRadius=0)  # -> Polygon, Length
pi = Pi(Factor=_2)
division = Division(A=thickness_of_cardboard, B=_2_2)
_2_3 = Integer(2)
vector_xyz = VectorXYZ(XComponent=division, YComponent=subtraction, ZComponent=0)  # -> Vector, Length
move = Move(Geometry=rectangle.Rectangle, Motion=vector_xyz.Vector)  # -> Geometry, Transform
division_2 = Division(A=pi, B=number_of_sides_of_polygon)
division_3 = Division(A=pi, B=_2_3)
addition = Addition(A=division_3, B=division_2)
rotate = Rotate(Geometry=move.Geometry, Angle=addition, Plane=PlaneXY(0, 0, 0))  # -> Geometry, Transform
multiplication_2 = Multiplication(A=radius_of_polygon, B=_2_2)
rectangle_2 = Rectangle(Plane=PlaneXY(0, 0, 0), XSize=multiplication_2, YSize=multiplication_2, Radius=0)  # -> Rectangle, Length
polar_array = PolarArray(Geometry=rotate.Geometry, Plane=PlaneXY(0, 0, 0), Count=number_of_sides_of_polygon, Angle=6.283185307)  # -> Geometry, Transform
_4 = Integer(4)
_3 = Integer(3)
region_difference = RegionDifference(CurvesA=polygon.Polygon, CurvesB=polar_array.Geometry)
rectangular_array = RectangularArray(Geometry=region_difference, Cell=rectangle_2.Rectangle, XCount=_4, YCount=_3)  # -> Geometry, Transform
